vi "Read From File ALT.gvi"   [LabVIEW Communications System Design Software 2.0.1]
panel controls:
  "file path": path
  "Max Freq": f64 = 120000000
  "Min Freq": f64 = 80000000
  "Waveform": waveform<f64> = {dt=0.1, Y=[]}
panel indicators:
  "FFT Power Spectrum": cluster{"f0": f64, "df": f64, "IQ": f64[]}
  "Numeric": i32
  "timestamp": timestamp
diagram:
  Strip Path(path=$"file path") -> (name=w1, stripped path=w2)
  Concatenate Strings("helper_", w1) -> w3
  Build Path(base path=w2, name or relative path=w3) -> (appended path=w4)
  TDMS Open(file path=w4, operation="open (read-only)") -> (tdms file out=w5)
  TDMS Read(data type=f64[] [], group name in="B,df", tdms file=w5) -> (data=w6, tdms file out=w7)
  Array Index(array=w6) -> (out0[_]=w8)
  To Long Integer(number=w8) -> w9
  Array Index(array=w6) -> (out0[1]=w10)
  # w9: B
  Multiply(w9, 2) -> w11
  Increment(x=w11) -> w12
  TDMS Open(file path=$"file path", operation="open (read-only)") -> (tdms file out=w13)
  # w10: df
  s1 = 0  # shift register
  s2 = 0  # shift register
  while {
    TDMS Read(count=20, data type=f64[] [], group name in="tod,len,fc", offset=s2, tdms file=w7) -> (data=w14, end of file?=w15, tdms file out=w16)
    # w17: len
    Array Index(array=w14) -> (out0[1]=w17)
    To Long Integer(number=w17) -> w18
    Add(s2, w18) -> w19
    Add(2, w19) -> w20
    Wait(time to wait=200)
    # w21: fc
    Array Subset(array=w14, index0=2, length0=w17) -> w21
    # w22: B*df
    Multiply(w9, w10) -> w22
    # w23: f0
    Subtract(x=w21, y=w22) -> w23
    w24 = $"Min Freq"
    w25 = $"Max Freq"
    s3 = s1  # shift register
    for (N = w18) (iteration -> i1) {
      w26 = each element of w23
      Increment(x=s3) -> w27
      Multiply(s3, w12) -> w28
      TDMS Read(count=w12, data type=$Waveform, group name in="Untitled", offset=w28, return channels in file order=TRUE, tdms file=w13) -> (data=w29, tdms file out=w30)
      Property Node(instance in=w29) -> ("Y"=w31)
      Is Equal To 0(x=i1) -> w32
      call "Put in Spectrum.gvi"(df=w10, data=w31, f0=w26, max freq=w25, Reset=w32, min freq=w24) -> (Spectrum to Plot=w33)
      next s3 = w27
    }
    $Numeric <- s3
    $"FFT Power Spectrum" <- w33
    # w34: tod
    Array Index(array=w14) -> (out0[0]=w34)
    To Time Stamp(number=w34) -> w35
    $timestamp <- w35
    next s1 = s3
    next s2 = w20
    stop if w15
  }
  TDMS Close(tdms file=w30)
  TDMS Close(tdms file=w16)
