vi "Spectrum Monitor.gvi"   [LabVIEW Communications System Design Software 2.0.1]
outputs:
  "LO Frequency": f64
  "Spectrum Size": i32
  "Frame Parameters Out": T5
panel controls:
  "RX Parameters In": T1 = {"IQ Sampling Rate [S/sec]"=20000000, "Gain [dB]"=0, "Reference Frequency"="Internal", "Timebase Clock Source"="Internal", "Start Carrier [Hz]"=95000000, "Stop Carrier [Hz]"=105000000, "Acq Duration [sec]"=0.0001, "Active Antenna"="RX2"}
  "Device Names": "niUSRPClass" = "192.168.10.2"
  "Averaging Parameters": "Averaging Parameters.gtype" = {"averaging mode"="RMS averaging", "weighting mode"="Linear", "number of averages"=4}  # averaging parameters defines how the averaging is computed. The specifications of the parameters include the type of averaging, the type of weighting, and the number of averages.
  "Display": T4 = {"display unit"="Vrms", "dB type"="dB"}
  "Stop Capture": bool
  "Tab": i32
  "threshold": f64 = -40
  "IQ frac": enum{"0.25", "0.5", "0.6", "0.8"} = "0.25"
  "file path": path
  "Waterfall Time Scale (s)": i32 = 5
panel indicators:
  "error out": error
  "Samples per Acquisition": i64
  "Carrier Freq Out": f64
  "FFT Power Spectrum": cluster{"f0": f64, "df": f64, "IQ": f64[]}
  "Carrier List": f64[]
  "Power Detection": "Power Detection cluster.gtype"
  "2D(freq,ind)": f64[][]
  "signals2D": f64[][]
  "df": f64
  "Trigger Save?": bool
  "f0": f64[]
  "Waterfall Plot": f64[][]
  "B": u32
types:
  T1 = cluster{"IQ Sampling Rate [S/sec]": f64, "Gain [dB]": f64, "Reference Frequency": string, "Timebase Clock Source": string, "Start Carrier [Hz]": f64, "Stop Carrier [Hz]": f64, "Acq Duration [sec]": f64, "Active Antenna": string}
  T2 = enum{"No averaging", "Vector averaging", "RMS averaging", "Peak hold"}
  "Averaging Parameters.gtype" = cluster{"averaging mode": T2, "weighting mode": enum{"Linear", "Exponential"}, "number of averages": u32}
  T3 = enum{"Vrms", "Vpk", "Vrms^2", "Vpk^2", "Vrms/rtHz", "Vpk/rtHz", "Vrms^2/Hz", "Vpk^2/Hz"}
  T4 = cluster{"display unit": T3, "dB type": enum{"Linear", "dB", "dBm"}}
  T5 = cluster{"IQ Rate": f64, "Frames": i32, "Length of Subset": i32, "Start Carrier [Hz": f64, "Stop Carrier [Hz]": f64, "Acq Duration [Sec]": f64, "Start Index of Subset": i32}
  "Power Detection cluster.gtype" = cluster{"Estimated Freqs. above Threshold": f64[], "Power at those Freqs.": f64[], "Num. peaks detected": i32, "Num. in queue": i32}
diagram:
  call "niUSRP Open Rx Session.gvi"(device names=$"Device Names") -> (error out=w1, session handle out=w2)
  call "Set Parameters.gvi"(RX Parameters In=$"RX Parameters In", USRP Session Handle In=w2, error in (no error)=w1, IQ frac=$"IQ frac") -> (error out: HW RX Param subsetup=w3, USRP Session Handle Out=w4, Test Carrier Frequencies=w5, Samples per Acquisition=w6, Frame Parameters Out=w7, IQ frac out=w8)
  Property Node(instance in=$"Averaging Parameters") -> ("number of averages"=w9, instance out=w10)
  call "niUSRP Configure Number of Samples.gvi"(session handle=w4, number of samples is finite=TRUE, number of samples=w6, error in=w3) -> (session handle out=w11, error out=w12)
  To Long Integer(number=w9) -> w13
  w14 = $"file path"
  w15 = $Display
  w16 = $threshold
  # Testing Spectrum Monitor. Not as many indicators will
  # be on panel in final version.
  s1 = uninitialised  # shift register
  while {
    Is First Call() -> w17
    # Go back to the first carrier frequency and repeat
    s2 = 0  # shift register
    for (iteration -> i1) {
      w18 = each element of w5
      call "Set Carrier and LO_2.gvi"(Current Frequency=w18, niusrp in_2=w11, error in=w12) -> (Error=w19, Usrp.niUSRPClass=w20)
      call "Array Indices for Sub-band.gvi"(First call=w17, error in=w19, 2D(freq,ind)=s1, niusrp in=w20, IQ frac=w8) -> (Local Interests=w21, error out=w22, Usrp.niUSRPClass out=w23)
      # Get new carrier frequency
      for (N = w13) (iteration -> i2) {
        # Averaging Loop
        call "Read Data.gvi"(USRP Session Handle In=w23, error in=w22, Number of Samples=w6) -> (USRP Session Handle Out=w25, error out=w26, data=w27)
        Is Equal To 0(x=i2) -> w28
        call "Establish Sub-band.gvi"(Restart Averaging=w28, Frame Parameters=w7, Averaging Parameters=w10, error in=w26, Input Baseband IQ=w27) -> (Power Spectrum averaged Subset=w29, Window Properties=w30, error out=w31, Frame Parameters Out=w32, power spectrum current=w33)
        call "Gather Signals for Saving.gvi"(Local Interests=w21, power spectrum current=w33, Window Properties=w30) -> (f0=w34, signals2D=w35, Trigger Save?=w36, df=w37, B=w38)
        $B <- w38
        # w28: First Rx for this carrier?
        Logical Or(w31, $"Stop Capture") -> w39
        append w31 to w24
        stop if w39
      }
      call "Save Data to File.gvi"(file path=w14, signals2D=w35, df=w37, f0=w34, Trigger Save?=w36)
      Merge Errors(w24) -> (error out=w40)
      Property Node(instance in=w25, error in=w40) -> ("Carrier Frequency"=w41, "LO Frequency"=w42, error out=w43, instance out=w44)
      $"Carrier Freq Out" <- w41
      $signals2D <- w35
      $f0 <- w34
      $"LO Frequency" <- w42
      $df <- w37
      $"Trigger Save?" <- w36
      call "Aggregate Sub-band into Spectrum.gvi"(Frame Parameters=w32, Power Spectrum Subset=w29, Window Properties In=w30, Display=w15, Iteration=i1) -> (Spectrum to Plot=w45, Frame Parameters Out=w46, Spectrum Size=w47)
      call "Plot Spectrum.gvi"(Frame Parameters=w46, Spectrum to Plot In=w45) -> (Spectrum to Plot Out=w48, Frame Parameters out=w49)
      $"FFT Power Spectrum" <- w48
      $"Spectrum Size" <- w47
      next s2 = w42
      stop if w39
    }
    call "Signal Power Detection_2.gvi"(Power Spectrum=w48, threshold=w16, Frame Parameters Out=w49) -> (Power at those Freqs.=w50, Est. Freqs above Thresh=w51, count=w52, sub_band_ind=w53)
    call "Array Fill.gvi"(sub_band_ind=w53, Est. Freqs above Thresh=w51, Count=w52) -> (2D(freq,ind)=w54, number elements in array=w55)
    $"2D(freq,ind)" <- w54
    Build Cluster(w51, w50, w52, w55) -> w56
    $"Power Detection" <- w56
    Property Node(instance in=w48) -> ("IQ"=w57)
    call "Waterfal Plot Generator.gvi"(Magnitude=w57, Waterfall Time Scale (s)=$"Waterfall Time Scale (s)") -> (Waterfall Plot=w58)
    $"Waterfall Plot" <- w58
    next s1 = w54
    stop if w39
  }
  call "niUSRP Abort.gvi"(session handle=w44, error in=w43) -> (session handle out=w59, error out=w60)
  call "niUSRP Close Session.gvi"(session handle=w59, error in=w60) -> (error out=w61)
  $"error out" <- w61
  $"Carrier List" <- w5
  $"Samples per Acquisition" <- w6
  $"Frame Parameters Out" <- w7
